# Grasshopper definition 14-simpledragon-two-zone-run-results-csv.gh (Grasshopper 1.0.7)
# plug-ins: SimpleDragon, InvisibleDragon

run_batch_explicit_rising_edge = Boolean(False)
prepare_packaged_runtime = Boolean(True)
run_explicit_rising_edge = Boolean(False)
two_closed_office_zones = Brep([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])
south_facade_windows = Curve([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])
opening_zone_indices = Integer([0, 1])
opening_face_indices = Integer([0, 0])
keep_work_directory = Boolean(True)
cancel_active_batch = Boolean(False)
batch_parallel_limit = Integer(1)
cancel_active_run = Boolean(False)
overwrite_csv = Boolean(False)
force_rerun = Boolean(False)
export_csv = Boolean(False)
# Rhino source model: Open 30-two-zone-office.3dm; relink by object names when live references are preferred.
packaged_office_profile = Panel("소규모사무실")
sd_profile = LookupSimpleDragonUsageProfile(Name=packaged_office_profile)  # -> Profile, AvailableNames, Diagnostics
sd_material = SimpleDragonMaterial(Name="Simple Material", Conductivity=0.04, Density=30, SpecificHeat=1400)
envelope_0_200_m = Slider(0.2, range=0.01..0.5)
sd_construction = SimpleDragonSurfaceConstruction(Name="Simple Construction", Materials=sd_material, Thicknesses=envelope_0_200_m)  # -> Construction, UValue
sd_fenestration = SimpleDragonFenestrationConstruction(Name="Simple Window", UValue=1.5, SHGC=0.5)  # -> Construction, Transparent
sd_zones = ExtractSimpleDragonZones(
    ZoneBreps=two_closed_office_zones,
    Profile=sd_profile.Profile,
    SurfaceConstruction=sd_construction.Construction,
    FenestrationConstruction=sd_fenestration.Construction,
    UnmatchedFloorBoundary="Ground",
    LightingPowerDensity=10,
    OpeningCurves=south_facade_windows,
    OpeningZoneIndices=opening_zone_indices,
    OpeningFaceIndices=opening_face_indices)  # -> Zones, Surfaces, GeometryMap, Diagnostics, GeometryMapData
sd_heat_pump = SimpleDragonHeatPump(Name="Heat Pump", Fuel=0, HeatingCOP=3, CoolingCOP=3)  # -> Source, Diagnostics
sd_ahu = SimpleDragonAirHandlingUnit(Name="Air Handling Unit", Source=sd_heat_pump.Source)  # -> Supply, Diagnostics
sd_boiler = SimpleDragonBoiler(Name="Boiler", Fuel=1, Efficiency=0.85, HotWaterSupply=False)  # -> Source, Diagnostics
sd_radiator = SimpleDragonRadiator(Name="Radiator", Source=sd_boiler.Source)  # -> Supply, Diagnostics
assign_sd_supplies = AssignSimpleDragonSupplySystems(Zone=sd_zones.Zones, Supplies=[sd_ahu.Supply, sd_radiator.Supply], ReplaceExisting=False)  # -> Zone, Diagnostics
sd_erv = SimpleDragonEnergyRecoveryVentilator(Name="Energy Recovery Ventilator", Airflow=0.2, HeatingEfficiency=0.7, CoolingEfficiency=0.45)  # -> ERV, Diagnostics
assign_sd_ervs = AssignSimpleDragonVentilationSystems(Zone=assign_sd_supplies.Zone, ERVs=sd_erv.ERV, ReplaceExisting=False)  # -> Zone, Diagnostics
sd_pv = SimpleDragonPhotovoltaicPanel(Name="Photovoltaic Panel", Area=10, Efficiency=0.2, Azimuth=180, Tilt=30)  # -> PV, Diagnostics
assemble_grm = AssembleSimpleDragonGRM(
    Name="SimpleDragon Model",
    Zones=assign_sd_ervs.Zone,
    NorthAxis=0,
    Address="서울특별시 종로구",
    Vintage="2020-01-01",
    MultifamilyHousing=False,
    Materials=sd_material,
    SurfaceConstructions=sd_construction.Construction,
    FenestrationConstructions=sd_fenestration.Construction,
    SourceSystems=[sd_heat_pump.Source, sd_boiler.Source],
    SupplySystems=[sd_ahu.Supply, sd_radiator.Supply],
    ERVSystems=sd_erv.ERV,
    PhotovoltaicPanels=sd_pv.PV)  # -> GRM, JSON, FloorArea, Diagnostics
grm_to_idf = ConvertSimpleDragonGRM(GRM=assemble_grm.GRM)  # -> EnergyModel, IDF, IDFText, EPWFile, Success, Diagnostics
geometry_provenance_map = Panel(sd_zones.GeometryMap)
total_floor_area = Panel(assemble_grm.FloorArea)
converted_idf = Panel(grm_to_idf.IDFText)
conversion_success = Panel(grm_to_idf.Success)
energyplus_24_2_root = Panel("")
address_selected_packaged_epw = Panel(grm_to_idf.EPWFile)
run_temp_root = Panel("..\temp\example-preview\energyplus-run")
run_timeout_2_min = Slider(2, range=1..30)
run = RunEnergyPlus(
    IDF=grm_to_idf.IDF,
    Weather=grm_to_idf.EPWFile,
    RuntimeRoot=energyplus_24_2_root,
    TempRoot=run_temp_root,
    Run=run_explicit_rising_edge,
    Cancel=cancel_active_run,
    ForceRerun=force_rerun,
    KeepWorkDirectory=keep_work_directory,
    Timeout=run_timeout_2_min,
    PrepareMissingRuntime=prepare_packaged_runtime)  # -> Result, State, Success, WorkDirectory, Diagnostics
sum = EnergyPlusResultSummary(Result=run.Result)  # -> RunID, State, Success, Warnings, Severe, Fatal, Elapsed, MonthlyTables, WorkDirectory, Diagnostics
build_grr = BuildSimpleDragonGRR(GRM=assemble_grm.GRM, EnergyPlusResult=run.Result)  # -> GRR, JSON, Success, Diagnostics
grr_summary = SimpleDragonGRRSummary(GRR=build_grr.GRR, Metric="SiteUses", Gross=False)  # -> TotalArea, AnnualTotal, MonthlyTotals, Carriers, CarrierTotals, EndUses, EndUseTotals, Basis
csv_export_directory = Panel("..\temp\example-preview\run-results-csv")
csv_case_id = Panel("two-zone-office")
export_csv_2 = ExportSimpleDragonCSV(
    GRR=build_grr.GRR,
    GRM=assemble_grm.GRM,
    Directory=csv_export_directory,
    CaseID=csv_case_id,
    Diagnostics=run.Diagnostics,
    GeometryMapData=sd_zones.GeometryMapData,
    Export=export_csv,
    Overwrite=overwrite_csv)  # -> FullDirectory, FileNames, FilePaths, Content, Written
batch_output_root = Panel("..\temp\example-preview\simpledragon-batch")
run_batch = RunSimpleDragonBatch(
    Models=assemble_grm.GRM,
    CaseIDs=csv_case_id,
    EPWPaths=grm_to_idf.EPWFile,
    RuntimeRoot=energyplus_24_2_root,
    OutputRoot=batch_output_root,
    ParallelLimit=batch_parallel_limit,
    Run=run_batch_explicit_rising_edge,
    Cancel=cancel_active_batch)  # -> State, CaseIDs, Statuses, CombinedCSV, Manifest, Complete, Diagnostics
energyplus_state = Panel(run.State)
energyplus_success = Panel(run.Success)
parsed_result_success = Panel(sum.Success)
grr_build_success = Panel(build_grr.Success)
annual_site_result = Panel(grr_summary.AnnualTotal)
csv_package_files = Panel(export_csv_2.FilePaths)
csv_written = Panel(export_csv_2.Written)
batch_state = Panel(run_batch.State)
batch_combined_csv = Panel(run_batch.CombinedCSV)
batch_manifest = Panel(run_batch.Manifest)
batch_complete = Panel(run_batch.Complete)
